# Grasshopper definition gh01.gh (Grasshopper 1.0.7)

number_slider = Slider(28, range=0..100)
cir = Circle(Plane=PlaneXY(0, 0, 0), Radius=Slider(20, range=0..100))
rad = Radians(Degrees=Slider(92, range=0..100))
number_slider_2 = Slider(1, range=0..1)
divide = DivideCurve(Curve=cir, Count=number_slider, Kinks=False)  # -> Points, Tangents, Parameters
rotate = Rotate(Geometry=cir, Angle=rad, Plane=PlaneXY(0, 0, 0))  # -> Geometry, Transform
points = PointList(Points=divide.Points, Size=number_slider_2)
Z = UnitZ(Factor=Slider(20, range=0..100))
move = Move(Geometry=rotate.Geometry, Motion=Z)  # -> Geometry, Transform
divide_2 = DivideCurve(Curve=move.Geometry, Count=number_slider, Kinks=False)  # -> Points, Tangents, Parameters
ln = Line(StartPoint=divide.Points, EndPoint=divide_2.Points)
points_2 = PointList(Points=divide_2.Points, Size=number_slider_2)
panel = Panel(divide.Points)
panel_2 = Panel(divide_2.Points)
