# Grasshopper definition gh02.gh (Grasshopper 1.0.7)

number_slider = Slider(65, range=0..100)
cir = Circle(Plane=PlaneXY(0, 0, 0), Radius=Slider(20, range=0..100))
rad = Radians(Degrees=Slider(92, range=0..100))
number_slider_2 = Slider(1, range=0..1)
divide = DivideCurve(Curve=cir, Count=number_slider, Kinks=False)  # -> Points, Tangents, Parameters
rotate = Rotate(Geometry=cir, Angle=rad, Plane=PlaneXY(0, 0, 0))  # -> Geometry, Transform
points = PointList(Points=divide.Points, Size=number_slider_2)
Z = UnitZ(Factor=Slider(20, range=0..100))
move = Move(Geometry=cir, Motion=Z)  # -> Geometry, Transform
divide_2 = DivideCurve(Curve=move.Geometry, Count=number_slider, Kinks=False)  # -> Points, Tangents, Parameters
points_2 = PointList(Points=divide_2.Points, Size=number_slider_2)
panel = Panel(divide.Points)
# shifting the list by 1
shift = ShiftList(List=divide_2.Points, Shift=Slider(10, range=0..10), Wrap=True)
ln = Line(StartPoint=divide.Points, EndPoint=shift)
panel_2 = Panel(shift)
