# Grasshopper definition gh03.gh (Grasshopper 1.0.7)

number_slider = Slider(65, range=0..100)
cir = Circle(Plane=PlaneXY(0, 0, 0), Radius=Slider(20, range=0..100))
rad = Radians(Degrees=Slider(92, range=0..100))
number_slider_2 = Slider(1, range=0..1)
divide = DivideCurve(Curve=cir, Count=number_slider, Kinks=False)  # -> Points, Tangents, Parameters
rotate = Rotate(Geometry=cir, Angle=rad, Plane=PlaneXY(0, 0, 0))  # -> Geometry, Transform
points = PointList(Points=divide.Points, Size=number_slider_2)
Z = UnitZ(Factor=Slider(20, range=0..100))
move = Move(Geometry=cir, Motion=Z)  # -> Geometry, Transform
divide_2 = DivideCurve(Curve=move.Geometry, Count=number_slider, Kinks=False)  # -> Points, Tangents, Parameters
points_2 = PointList(Points=divide_2.Points, Size=number_slider_2)
panel = Panel(divide.Points)
shift = ShiftList(List=divide_2.Points, Shift=Slider(10, range=0..10), Wrap=True)
ln = Line(StartPoint=divide.Points, EndPoint=shift)
panel_2 = Panel(shift)
loft_opt = LoftOptions(Closed=Toggle(True), Adjust=False, Rebuild=0, Refit=0, Type=0)
loft = Loft(Curves=ln, Options=loft_opt)
# converting to a 3d model.
# pipes for each line.
# 
# loft with the options to close the last segment
pipe = Pipe(Curve=ln, Radius=Slider(0.3, range=0..1), Caps=0)  # disabled
