# Grasshopper definition gh04.gh (Grasshopper 1.0.7)

number_slider = Slider(7, range=0..100)
box = CenterBox(Base=PlaneXY(0, 0, 0), X=number_slider, Y=number_slider, Z=number_slider)
debrep = DeconstructBrep(Brep=box)  # -> Faces, Edges, Vertices
md_slider = MDSlider(
    SliderMode=0,
    slider_value=Point(0.504854999, 0.4966077107, 0.5),
    x_domain=Domain(0, 1),
    y_domain=Domain(0, 1),
    z_domain=Domain(0, 1))
srf = Surface(debrep.Faces)
crv = Curve(debrep.Edges)
pt = Point(debrep.Vertices)
evalsrf = EvaluateSurface(Surface=reparameterize(srf), Point=md_slider)  # -> Point, Normal, UDirection, VDirection, Frame
Z = UnitZ(Factor=1)
vec = Vector(evalsrf.Normal)
panel = Panel(vec)
abs = Absolute(Value=panel)
angle = Angle(VectorA=abs, VectorB=Z)  # -> Angle, Reflex
deg = Degrees(Radians=angle.Angle)
panel_2 = Panel(abs)
panel_3 = Panel(deg)
smaller = SmallerThan(FirstNumber=panel_3, SecondNumber=Slider(0, range=0..100))  # -> SmallerThan, OrEqualTo
panel_4 = Panel(smaller.OrEqualTo)
dispatch = Dispatch(List=srf, DispatchPattern=smaller.OrEqualTo)  # -> ListA, ListB
srf_2 = Surface(dispatch.ListB)
