# Grasshopper definition test1.gh (Grasshopper 1.0.7)
# plug-ins: Robots

number_slider = Slider(5, range=0..100)
list = ValueList({"AA-KR60", "AA-KR30", "AA-KR60_KR30", "AARCH IRB120", "AARCH IRB6620", "AAU-Utzon-UR10", "Automata", "Bartlett-IRB120", "Bartlett-IRB1600", "Bartlett-KR6"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}, selected="Bartlett-IRB120")
pt = ConstructPoint(XCoordinate=0, YCoordinate=0, ZCoordinate=number_slider)
cone = Cone(Base=PlaneXY(0, 0, 0), Radius="20", Length=number_slider)  # -> Cone, Tip
load_robot = LoadRobotSystem(Name=list, Base=PlaneXY(0, 0, 0))
pt_2 = Point(Point(280.6194679, 0, 27.40982173))
mesh = MeshBrep(
    Brep=cone.Cone,
    Settings={GridMaxCount=0, GridMinCount=16, JaggedSeams=False, MaxEdgeLength=0, MinEdgeLength=0.0001, MinTolerance=0, Refine=True, RefineAngle=0, RelativeTolerance=0.65, SimplePlanes=True, Tolerance=0})
xy = XYPlane(Origin=pt)
xy_2 = XYPlane(Origin=pt_2)
K = Kinematics(DisplayGeometry=False)  # -> Meshes, Joints, Planes, Errors
flip = Flip(Surface=xy_2)  # -> Surface, Result
target = CreateTarget(Plane=flip.Surface, IsCartesian=True)
tool = CreateTool(Name="tool1", TCP=xy, Weight=0, Mesh=mesh)  # -> Tool, TCP
program = CreateProgram(Name="DefaultProgram", RobotSystem=load_robot, Targets1=target, StepSize=1)  # -> Program, Code, Duration, Warnings, Errors
sim = ProgramSimulation(Program=program.Program, Time=0, Normalized=True)  # -> SystemMeshes, JointRotations, Plane, Index, Time, Program, Errors
